# Grasshopper definition ghtest_v2.gh (Grasshopper 1.0.7)
# plug-ins: GHUI

path = FilePath("C:\Users\pmitev\Documents\GitHub\gh-ui\GHUI\Window.html")
panel = Panel(path)
ghui = GrasshopperUI(HTMLPath=path)
panel_2 = Panel(ghui)
