# Grasshopper definition CreateInterface.gh (Grasshopper 1.0.7)
# plug-ins: GHUI

panel = Panel("<!DOCTYPE html><html lang=en xmlns=http://www.w3.org/1999/xhtml><div id=app><h1>HELLO THERE</h1></div>")
path = FilePath("C:\Users\pmite\Documents\GitHub\gh-web-ui\GHUI\Web UI\createdInput.html")
panel_2 = Panel(path)
vue_ui = BuildVueUI(HTMLPath=path, HTMLString=panel)
panel_3 = Panel(vue_ui)
