# Grasshopper definition CreateInterfaceMoreComplex.gh (Grasshopper 1.0.7)
# plug-ins: GHUI

panel = Panel("Buttons")
button = CreateButton(Name="myButton2", ID="myButton2", Value="Run My Script!")

panel_2 = Panel("Sliders")
slider = CreateSlider(Name="mySlider", ID="mySlider", Value=50, Min=0, Max=100)
slider_2 = CreateSlider(Name="mySlider2", ID="mySlider2", Value=50, Min=0, Max=100)

panel_3 = Panel("Text/Number Input")
text = CreateTextInput(Name="text", ID="myTextBox", Value="Name?", CSS="margin-left: 10px;")

panel_4 = Panel("Labels")
label = CreateLabel(Name="label", ID="myTitle", Value="My Web Interface", Scale=1, CSS="font-family:Arial;")
label_2 = CreateLabel(
    Name="label",
    ID="label",
    Value="A web-based user-interface package for Grasshopper!",
    Scale="3",
    CSS="font-family:Arial;")

concat = Concatenate(FragmentA=label, FragmentD=label_2, FragmentB=button, FragmentC=text)
div = WrapInDiv(HTML=concat)

# ----
# Select Where to Create the HTML UI
path = FilePath("C:\Users\pmite\Documents\GitHub\gh-web-ui\GHUI\Web UI\createdInput.html")
html_ui_file_will_be_written_here = Panel(path)

# ----
# Inject External CSS/JS For Themes and Templates
# https://unpkg.com/tailwindcss@^2/dist/tailwind.min.css
panel_5 = Panel("https://cdn.jsdelivr.net/npm/bootstrap@5.0.0-beta3/dist/css/bootstrap.min.css")

panel_6 = Panel("Checkboxes")
toggle = BooleanToggle(False)
checkbox = CreateCheckboxInput(Name="checkbox", ID="myCheck1", Value=toggle, Label="Option 1")
checkbox_2 = CreateCheckboxInput(Name="checkbox", ID="myCheck2", Value=toggle, Label="Option 2", CSS="margin-left: 10px;")

panel_7 = Panel("Date and Time")
date = CreateDateInput(Name="date", ID="date", Min="1900-12-31", Max="2021-01-02")
time = CreateTimeInput(Name="time", ID="time")
concat_2 = Concatenate(FragmentA=time, FragmentB=date)
div_2 = WrapInDiv(HTML=concat_2)

panel_8 = Panel("Color Picker")
color = CreateColorInput(Name="color", ID="myColor")

panel_9 = Panel("Image")
image = CreateImageInput(Name="image", ID="image", URL="https://vuejs.org/images/logo.png", Height=300, Width=300)

panel_10 = Panel("""100
100
200""")

div_3 = WrapInDiv(HTML=checkbox_2)
div_4 = WrapInDiv(HTML=checkbox)
panel_11 = Panel("Grid Definition (Manual)")
div_5 = WrapInDiv(HTML=color)
grid = CreateGridContainer(Columns=2, ColumnSizes=panel_10, ColumnUnits="px")
concat_3 = Concatenate(FragmentA=div_4, FragmentB=div_3, FragmentC=div_5)
div_6 = WrapInDiv(HTML=concat_3, CSS=grid)

# ----
# Create Components to Display Results
panel_12 = Panel("font-family:Arial;")
label_3 = CreateLabel(Name="label", ID="label", Value="Distance in Rhino: ", Scale="3", CSS=panel_12)
label_4 = CreateLabel(Name="label", ID="myLabel", Value="label", Scale="3", CSS=panel_12)
concat_4 = Concatenate(FragmentA=label_3, FragmentB=label_4)

panel_13 = Panel("Layout & Styling")
panel_14 = Panel("""width:100%; height:100px; background:lightgray;
margin-top: 20px;
margin-bottom: 20px;""")
div_7 = WrapInDiv(HTML=concat_4, CSS=panel_14)

concat_5 = Concatenate(FragmentA=slider, FragmentB=slider_2)
grid_2 = CreateGridContainer(Columns="2", ColumnUnits="px")
panel_15 = Panel("Grid Definition (Auto)")

concat_6 = Concatenate(FragmentA=grid_2, FragmentB="margin-top:10px;")

div_8 = WrapInDiv(HTML=concat_5, CSS=concat_6)

# ----
# Combine UI Elements into Single Interface
concat_7 = Concatenate(FragmentE=div, FragmentC=div_8, FragmentA=div_7, FragmentD=div_6, FragmentB=div_2)
html_ui = BuildHTMLUI(HTMLPath=path, HTMLString=concat_7, Title="UI", CSSReferences=panel_5)  # -> Success, Path

panel_16 = Panel("Launch Full UI")
html_ui_2 = LaunchHTMLUI(HTMLPath=html_ui.Path, ShowWindow=Toggle(True), Title="UI")  # -> InputValues, InputIds, InputNames, InputTypes, WebWindow
names_of_inputs = Panel(html_ui_2.InputNames)
values_of_inputs = Panel(html_ui_2.InputValues)
ids_of_inputs = Panel(html_ui_2.InputIds)
types_of_inputs = Panel(html_ui_2.InputTypes)

# ----
# Use Inputs in Grasshopper!
panel_17 = Panel("3")
item = ListItem(List=values_of_inputs, Index=panel_17, Wrap=True)
item_2 = ListItem(List=values_of_inputs, Index="2", Wrap=True)
pt = ConstructPoint(XCoordinate=item, YCoordinate=item, ZCoordinate=item)
pt_2 = ConstructPoint(XCoordinate=item_2, YCoordinate=item_2, ZCoordinate=item_2)
dist = Distance(PointA=pt, PointB=pt_2)
ln = Line(StartPoint=pt, EndPoint=pt_2)
distance_between_points = Panel(dist)

# ----
# Set Values Based on Grasshopper-Computed Output
panel_18 = Panel("myLabel")
label_5 = SetLabel(IDs=panel_18, Values=dist)
set_ui = SETHTMLUI(WebWindow=html_ui_2.WebWindow, Setters=label_5)
