# Grasshopper definition SampleScriptHardcoded.gh (Grasshopper 1.0.7)
# plug-ins: GHUI

# ----
# Set Path & Define Window Parameters
panel = Panel("Wall Pricing Calculator")
path = FilePath("C:\Users\pmite\Documents\GitHub\gh-web-ui - PRIVATE\GHUI\Web UI\InputWallPricingScript.html")
ghui = GrasshopperUI(HTMLPath=path, ShowWindow=Toggle(True), Title=panel, Height=800, Width="600")  # -> InputValues, InputIds, InputNames, InputTypes, WebWindow
panel_2 = Panel(path)
ids = Panel(ghui.InputIds)
values = Panel(ghui.InputValues)

wall_height = Slider(24, range=1..100)

panel_3 = Panel("Grasshopper Operations")

item = ListItem(List=values, Index="0", Wrap=True)

item_2 = ListItem(List=values, Index="2", Wrap=True)
item_3 = ListItem(List=values, Index="3", Wrap=True)

item_4 = ListItem(List=values, Index="1", Wrap=True)

pt = ConstructPoint(XCoordinate=0, YCoordinate=0, ZCoordinate=0)
pt_2 = ConstructPoint(XCoordinate=0, YCoordinate=item, ZCoordinate=0)
ln = Line(StartPoint=pt, EndPoint=pt_2)
len = Length(Curve=ln)
end = EndPoints(Curve=ln)  # -> Start, End

Z = UnitZ(Factor=wall_height)
move = Move(Geometry=ln, Motion=Z)  # -> Geometry, Transform
line = Line(move.Geometry)
end_2 = EndPoints(Curve=line)  # -> Start, End

addition = Addition(A=item_2, B=item_3)
division = Division(A=len, B=addition)
round = Round(Number=division)  # -> Nearest, Floor, Ceiling
rectangle = Rectangle(Plane=PlaneXY(0, 0, 0), XSize=item_3, YSize=item_3, Radius=0)  # -> Rectangle, Length
arrcurve = CurveArray(Geometry=rectangle.Rectangle, Curve=ln, Count=round.Nearest)  # -> Geometry, Transform
Z_2 = UnitZ(Factor=wall_height)
number_of_studs = Panel(round.Nearest)
extr = Extrude(Base=arrcurve.Geometry, Direction=Z_2)

srf4pt = _4PointSurface(CornerA=end.Start, CornerB=end.End, CornerC=end_2.End, CornerD=end_2.Start)
area = Area(Geometry=srf4pt)  # -> Area, Centroid
wall_area = Panel(area.Area)

X = UnitX(Factor=item_4)
extr_2 = Extrude(Base=srf4pt, Direction=X)
volume = Volume(Geometry=extr_2)  # -> Volume, Centroid
wall_volume = Panel(volume.Volume)

# ----
# Set Values in UI
panel_4 = Panel("""studCountLabel
wallAreaLabel
wallVolumeLabel""")
merge = Merge(Data1=number_of_studs, Data2=wall_area, Data3=wall_volume)  # -> simplify(flatten(Result))
define_set = DefineSetValues(IDs=panel_4, Values=merge)
set = SetValues(WebWindow=ghui.WebWindow, Setters=define_set)
