# Grasshopper definition SampleScriptVanilla.gh (Grasshopper 1.0.7)

wall_length = Slider(52, range=0..200)
stud_size = Slider(1.158, range=0..2)
wall_height = Slider(24, range=1..100)
wall_depth = Slider(1.839, range=1..15)
stud_spacing = Slider(3.927, range=0..10)

pt = ConstructPoint(XCoordinate=0, YCoordinate=0, ZCoordinate=0)
pt_2 = ConstructPoint(XCoordinate=0, YCoordinate=wall_length, ZCoordinate=0)
ln = Line(StartPoint=pt, EndPoint=pt_2)
len = Length(Curve=ln)
end = EndPoints(Curve=ln)  # -> Start, End

Z = UnitZ(Factor=wall_height)
move = Move(Geometry=ln, Motion=Z)  # -> Geometry, Transform
line = Line(move.Geometry)
end_2 = EndPoints(Curve=line)  # -> Start, End

addition = Addition(A=stud_spacing, B=stud_size)
division = Division(A=len, B=addition)
round = Round(Number=division)  # -> Nearest, Floor, Ceiling
rectangle = Rectangle(Plane=PlaneXY(0, 0, 0), XSize=stud_size, YSize=stud_size, Radius=0)  # -> Rectangle, Length
arrcurve = CurveArray(Geometry=rectangle.Rectangle, Curve=ln, Count=round.Nearest)  # -> Geometry, Transform
Z_2 = UnitZ(Factor=wall_height)
number_of_studs = Panel(round.Nearest)
extr = Extrude(Base=arrcurve.Geometry, Direction=Z_2)

srf4pt = _4PointSurface(CornerA=end.Start, CornerB=end.End, CornerC=end_2.End, CornerD=end_2.Start)
area = Area(Geometry=srf4pt)  # -> Area, Centroid
wall_area = Panel(area.Area)

X = UnitX(Factor=wall_depth)
extr_2 = Extrude(Base=srf4pt, Direction=X)
volume = Volume(Geometry=extr_2)  # -> Volume, Centroid
wall_volume = Panel(volume.Volume)
