# Grasshopper definition ServeInterface.gh (Grasshopper 1.0.7)
# plug-ins: GHUI

path = FilePath("C:\Users\pmite\Documents\GitHub\gh-web-ui\GHUI\Web UI\InputVue.html")
panel = Panel(path)
ghui = GrasshopperUI(HTMLPath=path, ShowWindow=Toggle(True))  # -> InputValues, InputIds, InputNames, InputTypes
panel_2 = Panel(ghui.InputTypes)
panel_3 = Panel(ghui.InputIds)
panel_4 = Panel(ghui.InputValues)
panel_5 = Panel(ghui.InputNames)
item = ListItem(List=panel_4, Index=1, Wrap=True)
rec = DataRecorder(item, DataLimit=-10, RecordData=False)
panel_6 = Panel(rec)
