# Grasshopper definition ghtest2.gh (Grasshopper 1.0.7)
# plug-ins: GHUI

path = FilePath("C:\Users\pmite\Documents\GitHub\gh-web-ui\GHUI\Web UI\InputVue.html")
panel = Panel(path)
ghui = GrasshopperUI(HTMLPath=path, ShowWindow=Toggle(True))  # -> InputValues, InputIds
panel_2 = Panel(ghui.InputValues)
panel_3 = Panel(ghui.InputIds)
